# Grasshopper definition file_to_points.gh (Grasshopper 0.9.75)
# Copyright: 2013

path = FilePath("C:\Users\Brett Ian Balogh\Documents\Processing\INDUCTIVESCANNER\output.txt")
file = ReadFile(File=path, PerLineParse=True)
split = TextSplit(Text=file, Separators=",")
trim = TextTrim(Text=split, Start=True, End=True)
item = ListItem(List=trim, Index=2, Wrap=True)
item_2 = ListItem(List=trim, Index=0, Wrap=True)
item_3 = ListItem(List=trim, Index=1, Wrap=True)
pt = ConstructPoint(XCoordinate=item_2, YCoordinate=item_3, ZCoordinate=item)
